% Requirement links of Active_Aero_System.slx (R2019b)

block :1161 implements requirements.slreqx#6: H6: Actuator redundancy
block :1162 implements requirements.slreqx#6: H6: Actuator redundancy
block :1163 implements requirements.slreqx#7: H7: Actuator sensors
block :1164 implements requirements.slreqx#7: H7: Actuator sensors
block :1165 implements requirements.slreqx#7: H7: Actuator sensors
block :1166 implements requirements.slreqx#7: H7: Actuator sensors
block :1178 implements requirements.slreqx#21: L7: Critical fail detection time
block :1199 implements requirements.slreqx#3: H4: No unsafe condition on critical fail
block :1204 implements requirements.slreqx#19: L5: Prevent acceleration on critical fail
block :2 implements requirements.slreqx#1: H1: Performance
block :249 implements requirements.slreqx#9: L1: Increase downforce when traction limited
block :249 implements requirements.slreqx#10: L2: Decrease drag when not traction limited
block :253 implements requirements.slreqx#4: D1: Diagnostics flag
block :253 implements requirements.slreqx#24: D3: Identify non-critical fail
block :253 implements requirements.slreqx#8: H3: Identify non-critical fail
block :253 implements requirements.slreqx#2: H2: Identify critical fail
block :257 implements requirements.slreqx#23: D2: Wing increments
block :377 implements requirements.slreqx#18: L4: Limit speed on critical fail
block :377 implements requirements.slreqx#5: H5: Converge to safe state
block :655 implements requirements.slreqx#20: L6: Operating rate
block :757 implements requirements.slreqx#4: D1: Diagnostics flag