# Requirement set requirements (R2019b)

## 1 [H1] Performance
The system must improve the acceleration and top-speed of the vehicle without impacting braking capabilities.

### 1.1 [L1] Increase downforce when traction limited
The control subsystem shall increase the downforce of the car when it is traction limited.

#### 1.1.1 [D2] Identify non-critical fail
In the event of a non-critical failure, the failure should be detectable and identifiable.

### 1.2 [L2] Decrease drag when not traction limited
The control subsystem shall decrease drag when the car is not traction limited.

## 2 [H2] Identify critical fail
In the event of a system critical failure, the failure must be detectable and identifiable.

### 2.1 [L7] Critical fail detection time
The diagnostic subsystem shall detect critical failures in at most 50ms.

## 3 [H4] No unsafe condition on critical fail
In the event of a critical system failure, the vehicle must not be able to enter an unsafe condition.

### 3.1 [L4] Limit speed on critical fail
In the event of a critical failure, the control subsystem shall limit the vehicle’s speed to 100 km/h to prevent the vehicle from entering an unsafe condition.

## 4 [H5] Converge to safe state
In the event of a critical system failure which puts the vehicle in an unsafe condition, the system must help the vehicle converge to a safe condition.

### 4.1 [L5] Prevent acceleration on critical fail
In the event of a critical failure which puts the vehicle in an unsafe scenario, the control subsystem shall prevent any vehicle acceleration in order to slow the vehicle to a safe speed even if the driver doesn’t apply the brakes.

## 5 [H6] Actuator redundancy
The system shall have actuator redundancy.

### 5.1 [D3] Identify non-critical fail
In the event of a non-critical failure, the failure should be detectable and identifiable.

## 6 [H7] Actuator sensors
The system’s actuators should each be monitored by redundant sensors.

## 7 [H3] Identify non-critical fail
In the event of a non-critical failure, the failure should be detectable and identifiable.

### 7.1 [L8] Non-critical fail detection time
The diagnostic subsystem should detect non-critical failures in at most 50 ms.

## 8 [L3] Failure signal
In the event of a failure, the diagnostic subsystem shall output an 8-bit signal detailing the specific error.

### 8.1 [D1] Diagnostics flag
The 8-bit error code signal that is outputted by the diagnostic subsystem shall have a critical failure “flag” on the left-most (most significant) bit.

## 9 [L6] Operating rate
The system shall operate at a 15ms rate.